# Grasshopper definition AutomatePresentation.gh (Grasshopper 1.0.7)

x = Slider(0.3, range=0..1)
y = Slider(0.61, range=0..1)
z = Slider(1, range=0..1)
X = UnitX(Factor=x)
Y = UnitY(Factor=y)
Z = UnitZ(Factor=z)
pt = ConstructPoint(XCoordinate=0, YCoordinate=0, ZCoordinate=0)
ma = MassAddition(Input=[Y, Z, X])  # -> Result, PartialResults
move = Move(Geometry=pt, Motion=ma.Result)  # -> Geometry, Transform
data = Data([x, y, z])
box = Box2Pt(PointA=pt, PointB=move.Geometry, Plane=PlaneXY(0, 0, 0))
takescreenshot = CSharpScript(Run=Toggle(False), Reset=Button(), GalapagosSliders=data, Path="D:\\SSS\\Prodesa\\Felipe\\", ImageName="Test")  # -> out, A; inputs Run: Boolean, Reset: Boolean, GalapagosSliders: list of Double, Path: String, ImageName: String
# ---------- takescreenshot: C# ----------
    string pather = Path + ImageName + counter.ToString();

    GH_Document ghDocument = Component.OnPingDocument();

    if(ghDocument.IsModified && Run == true)
    {

      Rhino.RhinoApp.RunScript("_-ScreenCaptureToFile " + pather, true);

      counter++;

    }

    Print(pather);

    if(Reset == true) counter = 0;
# ---------- takescreenshot: C# additional code ----------
  int counter = 0;
# ---------- end takescreenshot ----------
X_2 = UnitX(Factor=Slider(1.645, range=0..10))
Y_2 = UnitY(Factor=Slider(1.175, range=0..10))
box_2 = Box(box)
addition = Addition(A=Y_2, B=X_2)
area = Area(Geometry=box_2, UseTasks=False)  # -> Area, Centroid
galapagos = Galapagos(fitness=area, gene=[x, z, y])
panel = Panel(takescreenshot.out)
move_2 = Move(Geometry=pt, Motion=addition)  # -> Geometry, Transform
tag = TextTag(Location=move_2.Geometry, Text=area.Area)
