# Grasshopper definition StressTest[0].gh (Grasshopper 1.0.7)
# plug-ins: SpacePartition, Human, PTComponentLibrary, Kangaroo2 Components, TT Toolbox

# ---- group: CustomContour
c_script = CSharpScript()  # -> indexPattern; inputs curveTree: tree of Curve; disabled
# ---------- c_script: C# ----------
    double maxZ = 0.0, minZ = 0.0;

    List<int> indexes = new List<int>();

    int branches = curveTree.BranchCount;

    indexes.Add(0);

    for( int i = 0; i < branches - 1; ++i )
    {

      maxZ = AreaMassProperties.Compute(curveTree.Branch(i)[curveTree.Branch(i).Count - 1]).Centroid.Z;

      minZ = AreaMassProperties.Compute(curveTree.Branch(i + 1)[curveTree.Branch(i).Count - 1]).Centroid.Z;

      for( int j = 0; j < curveTree.Branch(i).Count; ++j )
      {

        double Z = AreaMassProperties.Compute(curveTree.Branch(i)[j]).Centroid.Z;

        if( Z <= maxZ && Z >= minZ || Z == maxZ || Z == minZ )
        {

          indexes.Add(j);

        }

      }

    }

    maxZ = AreaMassProperties.Compute(curveTree.Branch(branches - 1)[curveTree.Branch(branches - 1).Count - 1]).Centroid.Z;
    minZ = AreaMassProperties.Compute(curveTree.Branch(branches - 2)[curveTree.Branch(branches - 2).Count - 1]).Centroid.Z;

    for( int i = 0; i < curveTree.Branch(branches - 1).Count; ++i )
    {

      double Z = AreaMassProperties.Compute(curveTree.Branch(branches - 1)[i]).Centroid.Z;

      if( Z <= maxZ && Z >= minZ && i == curveTree.Branch(branches - 1).Count - 1 )
      {

        indexes.Add(i);

      }

    }

    int fromI = 0, toI = 1;

    DataTree<int> dataOut = new DataTree<int>();
    int pather = 0;

    int countIndexes = indexes.Count, tempoCount = 0;

    for( int i = 2; i < countIndexes; ++i )
    {

      tempoCount++;

    }


    countIndexes += tempoCount;

    indexPattern = countIndexes;

    for( int i = 0; i < countIndexes; ++i )
    {

      var path = new GH_Path(pather);

      if( i % 2 == 0 )
      {

        dataOut.Add(indexes[fromI], path);
        dataOut.Add(indexes[toI], path);
        fromI++;
        toI++;
        pather++;

      }

    }
/*
    for( int i = 0; i < dataOut.BranchCount; ++i )
    {

      for( int j = 0; j < 2; ++j )
      {

        if( i % 2 != 1 && j % 2 != 0 )
        {

          dataOut.Branch(i)[j]--;

        }

      }

    }*/

    indexPattern = dataOut;
# ---------- end c_script ----------
c_script_2 = CSharpScript(dataOut=c_script)  # -> sortedTree, sortedPlanes; inputs curveTree: tree of Curve, frameTree: tree of Plane, dataOut: tree of Int32; disabled
# ---------- c_script_2: C# ----------
    var treeOut = new DataTree<Curve>();
    var planes = new DataTree<Plane>();

    int branches = curveTree.BranchCount;

    int tracker = 0;

    var pathy = new GH_Path();

    int tempo = 0, tempoMax = 0, tempoPlane = 0;

    for( int i = 0; i < branches; ++i )
    {

      for( int k = 0; k < branches; ++k )
      {

        pathy = new GH_Path(k);

        tempo = dataOut.Branch(k)[0];

        tempoMax = dataOut.Branch(k)[1];
        
        //if( tempo != tempoMax ) 

        for( int j = tempo; j < tempoMax + 1; ++j )
        {

          if( k != 0 )
          {

            if( i > tracker )
            {

              treeOut.Add(curveTree.Branch(i)[j], pathy);

            }

          }

          else
          {

            treeOut.Add(curveTree.Branch(i)[j], pathy);

          }

          tracker = k - 1;

        }

      }

      tempoPlane = dataOut.Branch(i)[0];

      /*if( i != 0 )

        tempoPlane++;*/

      for( int j = tempoPlane; j < dataOut.Branch(i)[1] + 1; ++j )
      {

        planes.Add(frameTree.Branch(i)[j], new GH_Path(i));

      }

    }

    sortedTree = treeOut;
    sortedPlanes = planes;
# ---------- end c_script_2 ----------
number_slider = Slider(0, range=0..100)  # disabled
number_slider_2 = Slider(0, range=0..100)  # disabled
cull_i = CullIndex(List=c_script_2.sortedTree, Indices=number_slider_2, Wrap=True)  # -> simplify(List); disabled
cull_i_2 = CullIndex(List=c_script_2.sortedPlanes, Indices=number_slider_2, Wrap=True)  # -> simplify(List); disabled
runion = RegionUnion(Curves=cull_i, Plane=cull_i_2)  # disabled

# ---- group: CustomPointsOutsideCurve
number_slider_3 = Slider(58, range=0..100)  # disabled
sdivide = DivideSurface(UCount=number_slider_3, VCount=number_slider_3)  # -> simplify(Points), Normals, Parameters; disabled
flatten = FlattenTree(Tree=sdivide.Points, Path="{0}")  # disabled
inside = PointWithinCurve(pts=sdivide.Points)  # -> simplify(B); inputs pts: list of Point3d, crv: list of Polyline; disabled
# ---------- inside: C# usings ----------
using System.IO;
using System.Linq;
using System.Data;
using System.Drawing;
using System.Reflection;
using System.Windows.Forms;
using System.Xml;
using System.Xml.Linq;
using System.Runtime.InteropServices;

using Rhino.DocObjects;
using Rhino.Collections;
using GH_IO;
using GH_IO.Serialization;
# ---------- inside: C# ----------
    var outside = new DataTree<Point3d>(); //Outside(pts, crv);

    var temp = Outside( pts, crv[0] );
    
    foreach( var item in temp )
    {
      
      outside.Add( item, new GH_Path(0) );
    
    }
    /*
    temp = Outside(outside.Branch(0), crv[1]);
    
    foreach( var item in temp )
    {
      
      outside.Add( item, new GH_Path(1) );
    
    }
    
    temp = Outside(outside.Branch(1), crv[2]);*/
    
    for( int i = 1; i < crv.Count; ++i )
    {
   
      foreach( var item in temp )
      {
      
        outside.Add(item, new GH_Path(i));
    
      }
    
      temp = Outside( outside.Branch(i), crv[i] );
      
    }
    
    B = temp;
# ---------- inside: C# additional code ----------
  System.Collections.Concurrent.ConcurrentBag<Point3d> Outside(List<Point3d> pts, Polyline crv)
  {

    var outside = new System.Collections.Concurrent.ConcurrentBag<Point3d>();
    System.Threading.Tasks.Parallel.ForEach(pts, pt =>
      {
      if(!IsInside(pt, crv))
      {
        outside.Add(pt);
      }
      });

    return outside;

  }

  bool IsInside (Point3d pt, Polyline crv)
  {
    Point3d pt1, pt2;
    bool oddNodes = false;

    for (int i = 0; i < crv.SegmentCount; i++) //for each contour line
    {

      pt1 = crv.SegmentAt(i).From; //get start and end pt
      pt2 = crv.SegmentAt(i).To;

      if ( (pt1[1] < pt[1] && pt2[1] >= pt[1] || pt2[1] < pt[1] && pt1[1] >= pt[1]) && (pt1[0] <= pt[0] || pt2[0] <= pt[0]) ) //if pt is between pts in y, and either of pts is before pt in x
        oddNodes ^= ( pt2[0] + (pt[1] - pt2[1]) * (pt1[0] - pt2[0]) / (pt1[1] - pt2[1]) < pt[0] ); //^= is xor
      //end.X + (pt-end).Y   * (start-end).X  /(start-end).Y   <   pt.X
    }


    if (!oddNodes)
    {
      double minDist = 1e10;
      for (int i = 0; i < crv.SegmentCount; i++) {
        Point3d cp = crv.SegmentAt(i).ClosestPoint(pt, true);
        //Point3d cp = mvContour[i].closestPoint(pt);
        //minDist = min(minDist, cp.distance(pt));
        minDist = Math.Min(minDist, cp.DistanceTo(pt));
      }
      if (minDist < 1e-10)
        return true;
    }

    if(oddNodes) return true;

    return false;
  }
# ---------- end inside ----------

# ---- group: NumberOfBuildings
number_slider_4 = Slider(5, range=0..10)

# ---- group: ÁreaUtil
crv = Curve(<curve referenced from the Rhino model>)

# ---- group: ÁreaBruta
crv_2 = Curve(<curve referenced from the Rhino model>)

# ---- group: BordeParqueadero
crv_3 = Curve(<curve referenced from the Rhino model>)

# ---- group: SeedPoints
dom = ConstructDomain(DomainStart=0, DomainEnd=1)
txt = Text("X")
txt_2 = Text("Y")
genemodifier = GenePoolModifier(GeneList=txt, Count=number_slider_4, Domain=dom, Randomize=Button(), PercentageOfRandomization=Slider(1, range=0..1))
genemodifier_2 = GenePoolModifier(GeneList=txt_2, Count=number_slider_4, Domain=dom, Randomize=Button(), PercentageOfRandomization=Slider(1, range=0..1))
Y = GenePool(Decimals=2, Maximum=1, Minimum=0, Value=[0.92, 0.35, 0.94, 1, 0.62])
X = GenePool(Decimals=2, Maximum=1, Minimum=0, Value=[0.54, 0.01, 1, 0, 0.35])
pt = ConstructPoint(XCoordinate=X, YCoordinate=Y, ZCoordinate=0)
area = Area(Geometry=crv, UseTasks=False)  # -> Area, Centroid
srf = Surface(crv)
scale = Scale(Geometry=srf, Center=area.Centroid, Factor=Slider(1, range=0..10))  # -> Geometry, Transform
evalsrf = EvaluateSurface(Surface=reparameterize(scale.Geometry), Point=pt)  # -> Point, Normal, UDirection, VDirection, Frame
srf_cp = SurfaceClosestPoint(Point=evalsrf.Point, Surface=scale.Geometry)  # -> Point, UVPoint, Distance
pt_2 = Point(srf_cp.Point)

# ----
number_slider_5 = Slider(1.8, range=1.8..10)

# ---- group: AlturaEntrePisos
number_slider_6 = Slider(2.4, range=0..10)

# ---- group: FillThemUp / alturaEntrepiso
number = Number(number_slider_6)

# ---- group: calculoParqueaderos
anchoparqueo = Slider(2.3, range=0..2.5)
largoparqueo = Slider(4.3, range=0..10)
circulacion = Slider(5, range=0..10)

# ---- group: FillThemUp / AreaApto
number_slider_7 = Slider(60.4, range=0..100)

# ---- group: referenciaViaAcceso
# Vía Acceso
curve = Curve(crv_3)

# ---- group: Parqueadero / PuntoEntradaLote
eval = EvaluateCurve(Curve=reparameterize(curve), Parameter=Slider(0.9643, range=0..1))  # -> Point, Tangent, Angle

# ---- group: Physics / Parqueadero
relay = Relay()

# ----
number_slider_8 = Slider(100, range=0..100)  # disabled
Y_2 = UnitY(Factor=number_slider_8)  # disabled

# ---- group: indicadores / áreaApto
number_2 = Number(number_slider_7)

# ---- group: indicadores / áreaParqueable
number_3 = Number()

# ---- group: indicadores / áreaEquipComunal
number_4 = Number()

# ---- group: indicadores / áreaCirculación
number_5 = Number()

# ---- group: indicadores / áreaPuntoFijo
number_6 = Number()

# ---- group: indicadores / áreaPrimerPiso
number_7 = Number()

# ---- group: indicadores / ocupaciónTotal
number_8 = Number()

# ---- group: AreaVendible / Circulacion
number_slider_9 = Slider(0.18, range=0..1)

# ----
galapagos = Galapagos(fitness=ma_17, gene=[X, Y, number_slider_14, number_slider_13, number_slider_12, widthheightratio, number_slider_5])

# ---- group: Excel / NúmeroPisosParqueadero
int = Integer(Slider(1, range=0..1))

# ---- group: Lote
area_2 = Area(Geometry=crv_2, UseTasks=False)  # -> Area, Centroid
area_3 = Area(Geometry=crv, UseTasks=False)  # -> Area, Centroid
panel = Panel(area_2.Area)
panel_2 = Panel(area_3.Area)

# ----
multiplication = Multiplication(A=area_2.Area, B=number_slider_5)
panel_3 = Panel(multiplication)
multiplication_2 = Multiplication(A=multiplication, B=number_slider_9)
addition = Addition(A=multiplication, B=multiplication_2)
division = Division(A=addition, B=number_slider_4)
panel_4 = Panel(division)
panel_5 = Panel(addition)
addition_2 = Addition(A=division, B=addition)

# ---- group: FillThemUp / areaTotalVendible
number_9 = Number(addition_2)

# ---- group: indicadores / áreaÚtilLote
number_10 = Number(area_2.Area)

# ---- group: indicadores
# INDICE DE OCUPACION (AREA CONSTRUIDA EN PRIMER PISO/AREA UTIL LOTE)	0.39, 	0.21, 	0.57
division_2 = Division(A=number_7, B=number_10)
panel_6 = Panel(division_2)

# % DE OCUPACION TOTAL (AREA TOTAL OCUPADA/AREA UTIL LOTE)	53.7%, 	38.7%, 	68.7%
division_3 = Division(A=number_8, B=number_10)
panel_7 = Panel(division_3)

# % DE AREA LIBRE = (AREA UTIL LOTE - AREA DE OCUPACION TOTAL / AREA UTIL LOTE)	46.3%, 	31.3%, 	61.3%
subtraction = Subtraction(A=number_10, B=number_8)
division_4 = Division(A=subtraction, B=number_10)
multiplication_3 = Multiplication(A=division_4, B=100)
panel_8 = Panel(multiplication_3)

# ---- group: Excel / ÁreaBruta
num = Number(area_2.Area)

# ---- group: Excel / ÁreaNetaUrbanizable
num_2 = Number(area_3.Area)

# ---- group: SameAreaDifferentRatios
txt_3 = Text("Percentage")
dom_2 = ConstructDomain(DomainStart=Slider(0.9, range=0..1), DomainEnd=Slider(1.572, range=0..10))
genemodifier_3 = GenePoolModifier(GeneList=txt_3, Count=number_slider_4, Domain=dom_2, Randomize=Button(), PercentageOfRandomization=Slider(1, range=0..1))
percentage = GenePool(Decimals=2, Maximum=1.572, Minimum=0.9, Value=[1.572, 1.572, 1.572, 1.572, 1.572])
num_3 = Number(1.112732212)
pt_3 = Point(pt_2)
pln = Plane(pt_3)
rotate = Rotate(Geometry=pln, Angle=expr("x-0.5*pi", num_3), Plane=pt_3)  # -> Geometry, Transform

# ---- group: FillThemUp / planeIniciales
plane = Plane(rotate.Geometry)

# ---- group: FillThemUp
difstor = Slider(0, range=0..10)
number_slider_10 = Slider(8, range=0..33)

# ----
division_5 = Division(A=division, B=number_slider_10)
panel_9 = Panel(division_5)

# ---- group: SameAreaDifferentRatios (continued)
multiplication_4 = Multiplication(A=division_5, B=number_slider_9)
subtraction_2 = Subtraction(A=division_5, B=multiplication_4)
sqrt = SquareRoot(Value=division_5)
multiplication_5 = Multiplication(A=sqrt, B=percentage)
division_6 = Division(A=division_5, B=multiplication_5)
multiplication_6 = Multiplication(A=division_6, B=0.5)
multiplication_7 = Multiplication(A=multiplication_5, B=0.5)
dom_3 = ConstructDomain(DomainStart=expr("-x", multiplication_6), DomainEnd=multiplication_6)
dom_4 = ConstructDomain(DomainStart=expr("-x", multiplication_7), DomainEnd=multiplication_7)

# ---- group: FillThemUp (continued)
domain = Domain(dom_4)
domain_2 = Domain(dom_3)
customgeoplacement = CSharpScript(diff=difstor, f=number, w=domain_2, h=domain, maxIter=number_slider_10, areaTotal=number_9, planes=flatten(plane))  # -> A, B; inputs diff: Int32, f: Double, w: list, h: list, maxIter: Int32, areaTotal: Double, planes: list of Plane
# ---------- customgeoplacement: C# ----------
    var listaRect = new DataTree<Rectangle3d>();
    double move = 0.0;
    var vectorList = new DataTree<Vector3d>();
    int size = planes.Count;
    Rectangle3d rectTemp = new Rectangle3d();
    double areaR = 0, temp = 0;

    for (int i = 0; i < size; ++i)
    {

      rectTemp = new Rectangle3d(planes[i], w[i], h[i]);

      var path = new GH_Path(i);

      for (int j = 0; j <= maxIter; ++j)
      {

        if( j != 0 )

          temp += f;

        areaR += AreaMassProperties.Compute(rectTemp.ToNurbsCurve()).Area;

        //vector = new Vector3d(0, 0, temp);


        rectTemp.Transform(Rhino.Geometry.Transform.Translation(0, 0, temp));
        listaRect.Add(rectTemp, path);
        move += temp;
        vectorList.Add(new Vector3d(0, 0, move), path);
        temp = 0;

        if (areaR * 1.025 >= areaTotal && areaR * 0.975 <= areaTotal) break;

      }

      maxIter -= diff;

      move = 0;

      if (areaR * 1.025 >= areaTotal && areaR * 0.975 <= areaTotal) break;

    }

    A = listaRect;
    B = vectorList;
    //Print(areaR.ToString());
# ---------- end customgeoplacement ----------
lng = ListLength(List=customgeoplacement.A)
subtraction_3 = Subtraction(A=lng, B=1)
cull_i_3 = CullIndex(List=customgeoplacement.A, Indices=subtraction_3, Wrap=True)
lng_2 = ListLength(List=customgeoplacement.B)
area_4 = Area(Geometry=cull_i_3)  # -> flatten(Area), Centroid
subtraction_4 = Subtraction(A=lng_2, B=1)
item = ListItem(List=customgeoplacement.A, Index=0, Wrap=True)
ma = MassAddition(Input=area_4.Area)  # -> Result, PartialResults
item_2 = ListItem(List=customgeoplacement.B, Index=subtraction_4, Wrap=True)
multiplication_8 = Multiplication(A=item_2, B=Slider(0.333, range=0..1))
panel_10 = Panel(ma.Result)
devec = DeconstructVector(Vector=flatten(multiplication_8))  # -> XComponent, YComponent, ZComponent

# ----
multiplication_9 = Multiplication(A=multiplication_5, B=division_6)
panel_11 = Panel(multiplication_9)

# ---- group: ScaleNUAislamientos
num_4 = Number(graft(multiplication_7))
num_5 = Number(graft(multiplication_6))
num_6 = Number([num_4, num_5])
sort = SortList(Keys=num_6, ValuesA=num_6)  # -> Keys, ValuesA
multiplication_10 = Multiplication(A=devec.ZComponent, B=Slider(0.5, range=0..1))
item_3 = ListItem(List=sort.ValuesA, Index=0, Wrap=True)  # -> Item, Item1
division_7 = Division(A=flatten(Slider(3.5, range=0..10)), B=flatten(item_3.Item))
division_8 = Division(A=flatten(Slider(2, range=0..10)), B=flatten(item_3.Item1))
number_slider_11 = Slider(1, range=0..1)
addition_3 = Addition(A=number_slider_11, B=division_7)
addition_4 = Addition(A=number_slider_11, B=division_8)
crv_4 = Curve(item)
scale_nu = ScaleNU(Geometry=crv_4, Plane=graft(rotate.Geometry), ScaleX=graft(addition_3), ScaleY=graft(addition_4), ScaleZ=1)  # -> Geometry, Transform

# ---- group: RescaleNU / Smallest
num_7 = Number(flatten(item_3.Item))

# ---- group: RescaleNU / Biggest
num_8 = Number(flatten(item_3.Item1))

# ----
lng_3 = ListLength(List=customgeoplacement.B)
lng_4 = ListLength(List=customgeoplacement.B)
multiplication_11 = Multiplication(A=lng_4, B=Slider(8, range=0..10))
multiplication_12 = Multiplication(A=multiplication_11, B=item)
flatten_2 = FlattenTree(Tree=multiplication_12, Path="{0}")
ma_2 = MassAddition(Input=flatten_2)  # -> Result, PartialResults
panel_12 = Panel(ma_2.Result)

# ---- group: Excel / PisosXTorre
int_2 = Integer(customgeoplacement.B)
lng_5 = ListLength(List=int_2)

# ---- group: Excel / AislamientoMinimoEntreTorres
num_9 = Number(devec.ZComponent)

# ---- group: FillThemUp / NumeroAptos
area_5 = Area(Geometry=cull_i_3)  # -> Area, Centroid

# ----
multiplication_13 = Multiplication(A=area_5.Area, B=number_slider_9)
subtraction_5 = Subtraction(A=area_5.Area, B=multiplication_13)
panel_13 = Panel(subtraction_5)

# ---- group: Comunal
number_slider_12 = Slider(0.3936, range=0..1)
number_slider_13 = Slider(0, range=0..1)
pt_4 = ConstructPoint(XCoordinate=number_slider_12, YCoordinate=number_slider_13, ZCoordinate=0)
evalsrf_2 = EvaluateSurface(Surface=reparameterize(scale.Geometry), Point=pt_4)  # -> Point, Normal, UDirection, VDirection, Frame
srf_cp_2 = SurfaceClosestPoint(Point=evalsrf_2.Point, Surface=scale.Geometry)  # -> Point, UVPoint, Distance
pt_5 = Point(srf_cp_2.Point)
crv_5 = Curve(<curve referenced from the Rhino model>)
area_6 = Area(Geometry=crv_5, UseTasks=False)  # -> Area, Centroid
widthheightratio = Slider(1.2, range=0.8..1.2)
sqrt_2 = SquareRoot(Value=area_6.Area)
multiplication_14 = Multiplication(A=sqrt_2, B=widthheightratio)
division_9 = Division(A=area_6.Area, B=multiplication_14)
multiplication_15 = Multiplication(A=division_9, B=0.5)
multiplication_16 = Multiplication(A=multiplication_14, B=0.5)
dom_5 = ConstructDomain(DomainStart=expr("-x", multiplication_15), DomainEnd=multiplication_15)
dom_6 = ConstructDomain(DomainStart=expr("-x", multiplication_16), DomainEnd=multiplication_16)
number_slider_14 = Slider(0.24, range=0..1)
rectangle = Rectangle(Plane=pt_5, XSize=dom_6, YSize=dom_5, Radius=0)  # -> Rectangle, Length
rad = Radians(Degrees=expr("x*90", number_slider_14))
number_slider_15 = Slider(1.25, range=0..5)
rotate_2 = Rotate(Geometry=rectangle.Rectangle, Angle=rad, Plane=pt_5)  # -> Geometry, Transform
offset = OffsetCurve(Curve=rotate_2.Geometry, Distance=number_slider_15, Plane=PlaneXY(0, 0, 0), Corners=1)
Z = UnitZ(Factor=Slider(0.01, range=0..0.01))
frgb = ColourRGBF(
    Alpha=Slider(0.5, range=0..1),
    Red=Slider(0.716, range=0..1),
    Green=Slider(0.335, range=0..1),
    Blue=Slider(1, range=0..1))
Z_2 = UnitZ(Factor=number_slider_6)

# ---- group: FillThemUp / NumeroAptos (continued)
ma_3 = MassAddition(Input=subtraction_5)  # -> Result, PartialResults
panel_14 = Panel(ma_3.Result)
division_10 = Division(A=ma_3.Result, B=number_slider_7)

# ---- group: FillThemUp / AptosXTorre
round = Round(Number=division_10)  # -> Nearest, Floor, Ceiling

# ---- group: FillThemUp / AptosTotal
ma_4 = MassAddition(Input=flatten(round.Nearest))  # -> Result, PartialResults

# ---- group: calculoParqueaderos
division_11 = Division(A=ma_4.Result, B=Slider(2, range=0..10))
division_12 = Division(A=ma_4.Result, B=Slider(30, range=0..30))
division_13 = Division(A=ma_4.Result, B=Slider(10, range=0..10))
round_2 = Round(Number=division_12)  # -> Nearest, Floor, Ceiling
round_3 = Round(Number=division_13)  # -> Nearest, Floor, Ceiling
round_4 = Round(Number=division_11)  # -> Nearest, Floor, Ceiling
parqvisitantes = Panel(round_3.Nearest)
parqmovreducida = Panel(round_2.Nearest)
parqprivados = Panel(round_4.Nearest)
mass_addition = MassAddition(Input=[round_4.Nearest, round_3.Nearest, parqmovreducida])  # -> Result, PartialResults
round_5 = Round(Number=mass_addition.Result)  # -> Nearest, Floor, Ceiling
totalparqueaderos = Panel(round_5.Nearest)

# ---- group: FillThemUp / NumeroAptos (continued)
panel_15 = Panel(round.Nearest)

# ----
panel_16 = Panel(ma_4.Result)

# ---- group: indicadores / totalParqueaderos
integer = Integer(ma_4.Result)

# ---- group: indicadores / totalUNViv
integer_2 = Integer(ma_4.Result)

# ---- group: MáximoAptos
expression = Expression(x=ma_4.Result, y=Slider(320, range=0..1000), Expression="If( x > y, 1000, 0 )")

# ---- group: indicadores
# AREA PROMEDIO PARQUEADERO (AREA PARQUEABLE/TOTAL PARQUEADEROS)	23.53, 	20.18, 	26.88
division_14 = Division(A=number_3, B=integer)
panel_17 = Panel(division_14)

# NUMERO DE VIV/Ha UTIL = (No. TOTAL DE APARTAMENTOS/AREA UTIL LOTE) 	257, 	170, 	344
division_15 = Division(A=number_10, B=10000)
round_6 = Round(Number=division_15)  # -> Nearest, Floor, Ceiling
division_16 = Division(A=integer_2, B=round_6.Nearest)
panel_18 = Panel(division_16)

# M2 DOTACION COMUNAL POR UNIDAD DE VIVIENDA (No Incluye Espacios Tecnicos)	2.09, 	1.36, 	2.82
addition_5 = Addition(B=number_4)
division_17 = Division(A=number_4, B=integer_2)
panel_19 = Panel(division_17)

# M2 PUNTO FIJO POR  UNIDAD DE VIVIENDA = (AREA PUNTOS FIJOS/No. TOTAL DE APARTAMENTOS)	5.41, 	4.69, 	6.13
division_18 = Division(A=number_6, B=integer_2)
panel_20 = Panel(division_18)

# RELACION PARQUEADEROS POR VIVIENDA=(TOTAL PARQUEADEROS / No. TOTAL DE VIVIENDAS, Incl visit)	0.43, 	0.36, 	0.50
division_19 = Division(A=integer, B=integer_2)
panel_21 = Panel(division_19)

# ---- group: Excel / RelaciónParqueaderos/Visitantes
ma_5 = MassAddition(Input=flatten(round.Nearest))  # -> Result, PartialResults
division_20 = Division(A=round_3.Nearest, B=ma_5.Result)

# ---- group: Excel / NúmeroTotalAptos
int_3 = Integer(ma_4.Result)

# ---- group: Excel / ParqueaderosPrivados
int_4 = Integer(round_5.Nearest)

# ---- group: Excel / RelaciónParqueaderos/Aptos
ma_6 = MassAddition(Input=flatten(round.Nearest))  # -> Result, PartialResults
division_21 = Division(A=int_4, B=ma_6.Result)

# ---- group: Parqueadero
number_slider_16 = Slider(0.18, range=0..1)
addition_6 = Addition(A=Slider(1, range=0..1), B=number_slider_16)
number_slider_17 = Slider(6.684, range=0..10)
multiplication_17 = Multiplication(A=anchoparqueo, B=addition_6)
vec = Vector(Vector(-22.45956841, -61.47663413, 0))
vec_2 = Vector(Vector(-88.68827312, 54.05051099, 0))
unit = UnitVector(Vector=vec)
multiplication_18 = Multiplication(A=unit, B=circulacion)
unit_2 = UnitVector(Vector=vec_2)
multiplication_19 = Multiplication(A=unit, B=multiplication_17)
multiplication_20 = Multiplication(A=unit_2, B=multiplication_17)
series = Series(Start=0, Step=multiplication_19, Count=Slider(27, range=0..100))
series_2 = Series(Start=0, Step=multiplication_20, Count=Slider(26, range=2..100))
multiplication_21 = Multiplication(A=unit, B=series)
multiplication_22 = Multiplication(A=unit_2, B=series_2)
move = Move(Geometry=eval.Point, Motion=multiplication_21)  # -> Geometry, Transform
Z_3 = UnitZ(Factor=1)
Z_4 = UnitZ(Factor=1)
xprod = CrossProduct(VectorA=vec, VectorB=Z_3, Unitize=False)  # -> Vector, Length
xprod_2 = CrossProduct(VectorA=vec_2, VectorB=Z_4, Unitize=False)  # -> Vector, Length
unit_3 = UnitVector(Vector=xprod.Vector)
unit_4 = UnitVector(Vector=xprod_2.Vector)

# ----
addition_7 = Addition(A=Slider(1, range=0..1), B=number_slider_16)
multiplication_23 = Multiplication(A=circulacion, B=addition_7)
addition_8 = Addition(A=Slider(1, range=0..1), B=number_slider_16)
multiplication_24 = Multiplication(A=largoparqueo, B=addition_8)

# ---- group: FloorPlan
voronoi = Voronoi(Points=rotate.Geometry, BruteForceOverride=False)  # disabled
number_slider_18 = Slider(8, range=0..100)  # disabled
number_slider_19 = Slider(0.001, range=0..0.001)  # disabled
number_slider_20 = Slider(0.5, range=0..1)  # disabled
number_slider_21 = Slider(769, range=0..1000)  # disabled
number_slider_22 = Slider(1000, range=0..1000)  # disabled
number_slider_23 = Slider(178, range=0..1000)  # disabled

# ---- group: Parqueadero (continued)
multiplication_25 = Multiplication(A=multiplication_23, B=0.5)
multiplication_26 = Multiplication(A=multiplication_23, B=0.5)
multiplication_27 = Multiplication(A=unit_3, B=multiplication_25)
multiplication_28 = Multiplication(A=unit_4, B=multiplication_26)
move_2 = Move(Geometry=move.Geometry, Motion=expr("-x", multiplication_27))  # -> Geometry, Transform
move_3 = Move(Geometry=move.Geometry, Motion=multiplication_27)  # -> Geometry, Transform
multiplication_29 = Multiplication(A=unit_3, B=multiplication_24)
multiplication_30 = Multiplication(A=unit_3, B=multiplication_24)
multiplication_31 = Multiplication(A=unit_4, B=multiplication_24)
multiplication_32 = Multiplication(A=unit_4, B=multiplication_24)
move_4 = Move(Geometry=move_2.Geometry, Motion=expr("-x", multiplication_30))  # -> Geometry, Transform
move_5 = Move(Geometry=move_3.Geometry, Motion=multiplication_29)  # -> Geometry, Transform
lng_6 = ListLength(List=move_5.Geometry)
subtraction_6 = Subtraction(A=lng_6, B=1)
item_4 = ListItem(List=move_5.Geometry, Index=subtraction_6, Wrap=True)
move_6 = Move(Geometry=item_4, Motion=multiplication_18)  # -> Geometry, Transform
move_7 = Move(Geometry=move_6.Geometry, Motion=multiplication_22)  # -> Geometry, Transform
move_8 = Move(Geometry=move_7.Geometry, Motion=expr("-x", multiplication_28))  # -> Geometry, Transform
move_9 = Move(Geometry=move_7.Geometry, Motion=multiplication_28)  # -> Geometry, Transform
move_10 = Move(Geometry=move_8.Geometry, Motion=expr("-x", multiplication_32))  # -> Geometry, Transform
move_11 = Move(Geometry=move_9.Geometry, Motion=multiplication_31)  # -> Geometry, Transform
pline = PolyLine(Vertices=move_3.Geometry, Closed=False)
pline_2 = PolyLine(Vertices=move_5.Geometry, Closed=False)
pline_3 = PolyLine(Vertices=move_2.Geometry, Closed=False)
pline_4 = PolyLine(Vertices=move_4.Geometry, Closed=False)
pline_5 = PolyLine(Vertices=move_9.Geometry, Closed=False)
pline_6 = PolyLine(Vertices=move_11.Geometry, Closed=False)
pline_7 = PolyLine(Vertices=move_8.Geometry, Closed=False)
pline_8 = PolyLine(Vertices=move_10.Geometry, Closed=False)
end = EndPoints(Curve=pline)  # -> Start, End
end_2 = EndPoints(Curve=pline_2)  # -> Start, End
end_3 = EndPoints(Curve=pline_3)  # -> Start, End
end_4 = EndPoints(Curve=pline_4)  # -> Start, End
end_5 = EndPoints(Curve=pline_5)  # -> Start, End
end_6 = EndPoints(Curve=pline_6)  # -> Start, End
end_7 = EndPoints(Curve=pline_7)  # -> Start, End
end_8 = EndPoints(Curve=pline_8)  # -> Start, End
ln = Line(StartPoint=end.Start, EndPoint=end_2.Start)
ln_2 = Line(StartPoint=end.End, EndPoint=end_2.End)
ln_3 = Line(StartPoint=end_3.Start, EndPoint=end_4.Start)
ln_4 = Line(StartPoint=end_3.End, EndPoint=end_4.End)
ln_5 = Line(StartPoint=end_5.Start, EndPoint=end_6.Start)
ln_6 = Line(StartPoint=end_5.End, EndPoint=end_6.End)
ln_7 = Line(StartPoint=end_7.Start, EndPoint=end_8.Start)
ln_8 = Line(StartPoint=end_7.End, EndPoint=end_8.End)
join = JoinCurves(Curves=[ln_2, ln, pline_2, pline], Preserve=False)
join_2 = JoinCurves(Curves=[ln_4, ln_3, pline_4, pline_3], Preserve=False)
join_3 = JoinCurves(Curves=[ln_6, ln_5, pline_6, pline_5], Preserve=False)
join_4 = JoinCurves(Curves=[ln_8, ln_7, pline_8, pline_7], Preserve=False)
ln_9 = Line(StartPoint=move_3.Geometry, EndPoint=move_5.Geometry)
ln_10 = Line(StartPoint=move_2.Geometry, EndPoint=move_4.Geometry)
ln_11 = Line(StartPoint=move_9.Geometry, EndPoint=move_11.Geometry)
ln_12 = Line(StartPoint=move_8.Geometry, EndPoint=move_10.Geometry)
srfsplit = SurfaceSplit(Surface=join, Curves=ln_9)
srfsplit_2 = SurfaceSplit(Surface=join_2, Curves=ln_10)
srfsplit_3 = SurfaceSplit(Surface=join_3, Curves=ln_11)
srfsplit_4 = SurfaceSplit(Surface=join_4, Curves=ln_12)
lng_7 = ListLength(List=move_11.Geometry)
lng_8 = ListLength(List=move_4.Geometry)
subtraction_7 = Subtraction(A=lng_7, B=1)
item_5 = ListItem(List=move_10.Geometry, Index=0, Wrap=True)
lng_9 = ListLength(List=move_10.Geometry)
ccx = CurveCurve(CurveA=join_3, CurveB=join)  # -> Points, ParamsA, ParamsB
subtraction_8 = Subtraction(A=lng_8, B=1)
subtraction_9 = Subtraction(A=lng_9, B=1)
item_6 = ListItem(List=move_11.Geometry, Index=subtraction_7, Wrap=True)
item_7 = ListItem(List=move_4.Geometry, Index=subtraction_8, Wrap=True)
item_8 = ListItem(List=move_10.Geometry, Index=subtraction_9, Wrap=True)
item_9 = ListItem(List=move_4.Geometry, Index=0, Wrap=True)
move_12 = Move(Geometry=item_5, Motion=expr("-x", vec_2))  # -> Geometry, Transform
move_13 = Move(Geometry=item_7, Motion=vec)  # -> Geometry, Transform
ln_13 = Line(StartPoint=move_12.Geometry, EndPoint=item_5)
ln_14 = Line(StartPoint=move_13.Geometry, EndPoint=item_7)
ccx_2 = CurveCurve(CurveA=ln_14, CurveB=ln_13)  # -> Points, ParamsA, ParamsB
item_10 = ListItem(List=move_5.Geometry, Index=0, Wrap=True)
ln_15 = Line(StartPoint=item_6, EndPoint=item_8)
ln_16 = Line(StartPoint=item_8, EndPoint=ccx_2.Points)
ln_17 = Line(StartPoint=ccx_2.Points, EndPoint=item_9)

# ----
relay_2 = Relay([srfsplit, srfsplit_2, srfsplit_3, srfsplit_4])
move_14 = Move(Geometry=item_10, Motion=expr("-x*5", unit))  # -> Geometry, Transform
ln_18 = Line(StartPoint=move_14.Geometry, EndPoint=item_10)
ccx_3 = CurveCurve(CurveA=curve, CurveB=ln_18)  # -> Points, ParamsA, ParamsB

# ---- group: Parqueadero (continued)
lng_10 = ListLength(List=relay_2)
ma_7 = MassAddition(Input=lng_10)  # -> Result, PartialResults
multiplication_33 = Multiplication(A=ma_7.Result, B=2)
parqueaderos = Panel(multiplication_33)
ln_19 = Line(StartPoint=ccx_3.Points, EndPoint=item_6)
eval_2 = EvaluateCurve(Curve=reparameterize(ln_19), Parameter=Slider(0.5, range=0..1))  # -> Point, Tangent, Angle
dist = Distance(PointA=ccx.Points, PointB=eval_2.Point)
sort_2 = SortList(Keys=dist, ValuesA=ccx.Points)  # -> Keys, ValuesA
item_11 = ListItem(List=sort_2.ValuesA, Index=0, Wrap=True)
ln_20 = Line(StartPoint=item_9, EndPoint=ccx_3.Points)
ln_21 = Line(StartPoint=ccx_3.Points, EndPoint=item_11)
ln_22 = Line(StartPoint=item_11, EndPoint=item_6)
join_5 = JoinCurves(Curves=flatten([ln_20, ln_21, ln_22, ln_15, ln_16, ln_17]), Preserve=False)
crv_6 = Curve(join_5)

# ---- group: bloqueParqueaderos
frgb_2 = ColourRGBF(Alpha=Slider(1, range=0..1), Red=Slider(0.3, range=0..1), Green=Slider(0.3, range=0..1), Blue=Slider(0.3, range=0..1))
move_15 = Move(Geometry=relay_2, Motion=Z)  # -> Geometry, Transform
preview = CustomPreview(Geometry=move_15.Geometry, Material=frgb_2)

# ---- group: Physics / EnclosingCurve
rdiff = RegionDifference(CurvesA=crv, CurvesB=crv_6)
crv_7 = Curve(rdiff)
divide = DivideCurve(Curve=crv_7, Count=Slider(100, range=0..100), Kinks=False, UseTasks=False)  # -> Points, Tangents, Parameters
disc = Discontinuity(Curve=crv_7, Level=2)  # -> Points, Parameters; disabled

# ---- group: Physics
pline_9 = PolyLine(Vertices=divide.Points, Closed=True)
merge = Merge(Data1=offset, Data3=scale_nu.Geometry)
flatten_3 = FlattenTree(Tree=merge, Path="{0}")

# ---- group: Physics / EnclosingCurve (continued)
offsettree = CSharpScript(tree=pline_9, distance=Slider(50, range=-100..100))  # -> out, A; inputs tree: tree of Curve, distance: Double
# ---------- offsettree: C# ----------
    /*var curves = x.Offset(Plane.WorldXY, -10, 1e-3, CurveOffsetCornerStyle.Sharp);

    var list = new List<Curve>();
    list.AddRange(curves);
    list.Add(x);

    Brep[] brep = Brep.CreateFromLoft(list, Point3d.Unset, Point3d.Unset, LoftType.Normal, false);

    A = brep;*/

    int branches = tree.BranchCount;

    DataTree<Curve> treeOut = new DataTree<Curve>();
    GH_Path path = new GH_Path();

    for( int i = 0; i < branches; ++i )
    {

      path = new GH_Path(i);

      //for( int j = 0; j < tree.Branch(i).Count; ++j )
      {

        treeOut.Add(tree.Branch(i)[0], path);
        treeOut.AddRange(tree.Branch(i)[0].Offset(Plane.WorldXY, distance, 1e-3, CurveOffsetCornerStyle.Sharp), path);

      }

    }

    A = treeOut;
# ---------- end offsettree ----------
loft = Loft(Curves=offsettree.A, Options={Adjust=False, Closed=False, LoftEnds=0, LoftSimp=0, LoftType=0, Rebuild=10, Refit=0.01})
debrep = DeconstructBrep(Brep=loft)  # -> simplify(Faces), Edges, Vertices
wires = BrepWireframe(Brep=debrep.Faces, Density=-1)
join_6 = JoinCurves(Curves=wires, Preserve=False)  # -> flatten(Curves)

# ---- group: Physics (continued)
cc = CurveCollide(Curves=flatten(flatten_3), PassiveCurves=join_6, BasePlane=PlaneXY(0, 0, 0), Strength=Slider(0.469, range=0..10))  # -> Goal, Frames
data = Data(flatten(cc.Goal))
customkangaroo = CSharpScript(
    Goals=data,
    Reset=Toggle(True),
    Iter=Slider(15, range=0..100),
    Reference="C:\Program Files\Rhino 6\Plug-ins\Grasshopper\Components\KangarooSolver.dll")  # -> A; inputs Goals: list, Reset: Boolean, Iter: Int32
# ---------- customkangaroo: C# usings ----------
using System.IO;
using System.Linq;
using System.Data;
using System.Drawing;
using System.Reflection;
using System.Windows.Forms;
using System.Xml;
using System.Xml.Linq;
using System.Runtime.InteropServices;

using Rhino.DocObjects;
using Rhino.Collections;
using GH_IO;
using GH_IO.Serialization;
using KangarooSolver;
using KangarooSolver.Goals;
# ---------- customkangaroo: C# ----------
    if( Reset )
    {

      PS = new KangarooSolver.PhysicalSystem();

      GoalList.Clear();

      foreach( IGoal G in Goals ) //Assign indexes to the particles in each Goal:
        //System.Threading.Tasks.Parallel.ForEach(Goals, G =>
      {

        PS.AssignPIndex(G, 0.0001); // the second argument is the tolerance distance below which points combine into a single particle
        GoalList.Add(G);

      }
      //);

    }

    for( int i = 0; i < Iter; ++i )
      //System.Threading.Tasks.Parallel.For(0, Iter, i =>
    {

      PS.Step(GoalList, true, 1);

    }
    //);

    A = PS.GetOutput(GoalList);
# ---------- customkangaroo: C# additional code ----------
  KangarooSolver.PhysicalSystem PS = new KangarooSolver.PhysicalSystem();
  List<IGoal> GoalList = new List<IGoal>();
# ---------- end customkangaroo ----------
objecttocurves = CSharpScript(x=customkangaroo)  # -> A; inputs x: list
# ---------- objecttocurves: C# ----------
    /*
    var listOut = new DataTree<Curve>();
    var list = new object[x.Count];
    Curve temp = null;

    for( int i = 0; i < x.Count; ++i )
    {

      list = ( object[] ) x[i];

      for( int j = 0; j < list.Length; ++j )
      {

        GH_Convert.ToCurve(list[j], ref temp, GH_Conversion.Both);

        listOut.Add(temp, new GH_Path(i));

      }

    }
*/
    A = x[0];
# ---------- end objecttocurves ----------

# ---- group: FloorPlan (continued)
srf_2 = Surface(crv_7)  # disabled
sdivide_2 = DivideSurface(Surface=srf_2, UCount=number_slider_18, VCount=number_slider_18)  # -> Points, Normals, Parameters; disabled
ptborders = GenerateBorders(Grid=sdivide_2.Points, PanelShape=0, Surface=srf_2)  # disabled
rint = RegionIntersection(CurvesA=voronoi, CurvesB=pline_9)  # disabled
flatten_4 = FlattenTree(Tree=ptborders, Path="{0}")  # disabled
item_12 = ListItem(List=flatten_4, Index=0, Wrap=True)  # disabled
area_7 = Area(Geometry=item_12, UseTasks=False)  # -> Area, Centroid; disabled
multiplication_34 = Multiplication(A=area_7.Area, B=number_slider_20)  # disabled
spacepartition = SpacePartition(VoronoiIn=rint, GridIn=flatten_4, AreaIn=multiplication_34, Tolerance=number_slider_19)  # disabled
sortxy = SortPointsXY(Grid=flatten(spacepartition))  # disabled
sortxy_2 = SortPointsXY(Grid=flatten(flatten_4))  # disabled
pararunion = ParallelRegionUnion(Curves=spacepartition)  # disabled
missing = MissingGridCells(CulledGrid=sortxy, OriginalGrid=sortxy_2)  # disabled
mgtree = MergeTreeMissing(CulledGrid=simplify(pararunion), MissingGridCells=missing)  # disabled
pararunion_2 = ParallelRegionUnion(Curves=mgtree)  # disabled
lng_11 = ListLength(List=flatten(pararunion_2))  # disabled
srf_3 = Surface(pararunion_2)  # disabled
random = Random(Range=Domain(0, 1), Number=lng_11, Seed=number_slider_21)  # disabled
random_2 = Random(Range=Domain(0, 1), Number=lng_11, Seed=number_slider_22)  # disabled
random_3 = Random(Range=Domain(0, 1), Number=lng_11, Seed=number_slider_23)  # disabled
frgb_3 = ColourRGBF(Alpha=1, Red=random_2, Green=random, Blue=random_3)  # disabled

# ----
move_16 = Move(Geometry=srf_3, Motion=Y_2)  # -> Geometry, Transform; disabled

# ---- group: FloorPlan (continued)
preview_2 = CustomPreview(Geometry=move_16.Geometry, Material=graft(frgb_3))  # disabled

# ---- group: Ortho
D = Direction(Vector(87.27427758, -44.28019983, 0))
Z_5 = UnitZ(Factor=1)
xprod_3 = CrossProduct(VectorA=D, VectorB=Z_5, Unitize=False)  # -> Vector, Length

# ---- group: PullToBoundary
debrep_2 = DeconstructBrep(Brep=objecttocurves)  # -> Faces, Edges, Vertices
eval_3 = EvaluateCurve(Curve=reparameterize(debrep_2.Edges), Parameter=0.5)  # -> Point, Tangent, Angle
area_8 = Area(Geometry=objecttocurves, UseTasks=False)  # -> Area, graft(Centroid)
number_slider_24 = Slider(1, range=0..1)
number_slider_25 = Slider(0, range=0..100)
crv_8 = Curve(rdiff)

# ---- group: Ortho (continued)
addition_9 = Addition(A=eval_3.Point, B=xprod_3.Vector)
addition_10 = Addition(A=eval_3.Point, B=xprod_3.Vector)
pdecon = Deconstruct(Point=addition_9)  # -> XComponent, YComponent, ZComponent
pdecon_2 = Deconstruct(Point=addition_10)  # -> XComponent, YComponent, ZComponent
multiplication_35 = Multiplication(A=pdecon.XComponent, B=Slider(1000, range=0..1000))
sort_3 = SortList(Keys=multiplication_35, ValuesA=eval_3.Point)  # -> Keys, ValuesA
sort_4 = SortList(Keys=pdecon_2.XComponent, ValuesA=eval_3.Point)  # -> Keys, ValuesA
points = PointList(Points=sort_3.ValuesA, Size=Slider(4.95, range=0..10))
points_2 = PointList(Points=sort_4.ValuesA, Size=Slider(4.95, range=0..10))
pt_6 = Point(area_8.Centroid)
item_13 = ListItem(List=sort_4.ValuesA, Index=Slider(3, range=0..10), Wrap=True)
item_14 = ListItem(List=sort_3.ValuesA, Index=Slider(1, range=0..10), Wrap=True)
item_15 = ListItem(List=sort_3.ValuesA, Index=Slider(2, range=0..2), Wrap=True)
expression_2 = Expression(x=item_14, y=item_15, Expression="If( x.Y > y.Y, x, y )")
ln_23 = Line(StartPoint=pt_6, EndPoint=item_13)
ln_24 = Line(StartPoint=pt_6, EndPoint=expression_2)
lnln = LineLine(LineA=flatten(ln_23), LineB=flatten(ln_24))
align = AlignPlane(Plane=lnln, Direction=D)  # -> Plane, Angle
deg = Degrees(Radians=align.Angle)
expression_3 = Expression(x=deg, y=Slider(90, range=0..100), Expression="If( x < 0, If( x < -45, x + y, x ), x )")
rad_2 = Radians(Degrees=expression_3)
rotate_3 = Rotate(Geometry=objecttocurves, Angle=rad_2, Plane=lnln)  # -> Geometry, Transform

# ---- group: RescaleNU
len = Length(Curve=ln_23)
len_2 = Length(Curve=ln_24)
number_slider_26 = Slider(2, range=0..10)

# ---- group: PullToBoundary (continued)
sort_5 = SortList(Keys=area_8.Area, ValuesA=rotate_3.Geometry)  # -> Keys, ValuesA

# ---- group: PullToBoundary / Comunal
item_16 = ListItem(List=sort_5.ValuesA, Index=number_slider_25, Wrap=True)

# ---- group: PullToBoundary / Edificios
cull_i_4 = CullIndex(List=sort_5.ValuesA, Indices=number_slider_25, Wrap=True)

# ---- group: RescaleNU (continued)
crv_9 = Curve(cull_i_4)
debrep_3 = DeconstructBrep(Brep=crv_9)  # -> Faces, Edges, Vertices
area_9 = Area(Geometry=crv_9, UseTasks=False)  # -> Area, graft(Centroid)
eval_4 = EvaluateCurve(Curve=reparameterize(debrep_3.Edges), Parameter=0.5)  # -> Point, Tangent, Angle
disc_2 = Discontinuity(Curve=crv_9, Level=1)  # -> Points, Parameters
rectangle_2 = Rectangle(Plane=area_9.Centroid, XSize=Domain(-1, 1), YSize=Domain(-2, 2), Radius=0)  # -> Rectangle, Length
pln_2 = Plane(area_9.Centroid)
align_2 = AlignPlane(Plane=pln_2, Direction=xprod_3.Vector)  # -> Plane, Angle
addition_11 = Addition(A=eval_4.Point, B=xprod_3.Vector)
pdecon_3 = Deconstruct(Point=addition_11)  # -> XComponent, YComponent, ZComponent
sort_6 = SortList(Keys=pdecon_3.XComponent, ValuesA=eval_4.Point)  # -> Keys, ValuesA
points_3 = PointList(Points=sort_6.ValuesA, Size=Slider(4.95, range=0..10))
item_17 = ListItem(List=eval_4.Point, Index=Slider(2, range=0..10), Wrap=True)
item_18 = ListItem(List=eval_4.Point, Index=Slider(3, range=0..10), Wrap=True)
ln_25 = Line(StartPoint=area_9.Centroid, EndPoint=item_18)
ln_26 = Line(StartPoint=area_9.Centroid, EndPoint=item_17)
lnln_2 = LineLine(LineA=flatten(ln_25), LineB=flatten(ln_26))
anchoslargos = CSharpScript(plantas=crv_9)  # -> graft(ancho), graft(largo); inputs plantas: tree of Rectangle3d
# ---------- anchoslargos: C# ----------
    DataTree<double> anchosOut = new DataTree<double>(), largosOut = new DataTree<double>();

    Rectangle3d temp = new Rectangle3d();

    GH_Path path = new GH_Path();

    for( int i = 0; i < plantas.BranchCount; ++i )
    {

      path = plantas.Path(i);

      for( int j = 0; j < plantas.Branch(i).Count; ++j )
      {

        temp = plantas.Branch(i)[j];
        
        anchosOut.Add(temp.Width, path);
        largosOut.Add(temp.Height, path);

      }

    }

    ancho = anchosOut;
    largo = largosOut;
# ---------- end anchoslargos ----------
sort_7 = SortList(Keys=[anchoslargos.ancho, anchoslargos.largo], ValuesA=[anchoslargos.ancho, anchoslargos.largo])  # -> Keys, ValuesA
item_19 = ListItem(List=sort_7.ValuesA, Index=0, Wrap=True)  # -> Item, Item1
division_22 = Division(A=flatten(num_8), B=flatten(item_19.Item1))
division_23 = Division(A=flatten(num_7), B=flatten(item_19.Item))
multiplication_36 = Multiplication(A=number_slider_26, B=division_23)
multiplication_37 = Multiplication(A=division_22, B=number_slider_26)
crv_10 = Curve(crv_9)
scale_nu_2 = ScaleNU(Geometry=crv_10, Plane=lnln_2, ScaleX=multiplication_36, ScaleY=multiplication_37, ScaleZ=1)  # -> Geometry, Transform

# ---- group: PullToBoundary (continued)
offset_2 = OffsetCurve(Curve=item_16, Distance=expr("-x", number_slider_15), Plane=PlaneXY(0, 0, 0), Corners=1)
area_10 = Area(Geometry=offset_2, UseTasks=False)  # -> Area, Centroid
crvprox = CurveProximity(CurveA=crv_9, CurveB=crv_8)  # -> PointA, PointB, Distance
crvprox_2 = CurveProximity(CurveA=scale_nu_2.Geometry, CurveB=crv_8)  # -> PointA, PointB, Distance
vec2pt = Vector2Pt(PointA=crvprox_2.PointA, PointB=crvprox_2.PointB, Unitize=False)  # -> Vector, Length
move_17 = Move(Geometry=flatten(scale_nu_2.Geometry), Motion=vec2pt.Vector)  # -> Geometry, Transform
move_18 = Move(Geometry=flatten(crv_9), Motion=vec2pt.Vector)  # -> Geometry, Transform
crv_11 = Curve([move_18.Geometry, item_16])

# ----
crv_12 = Curve(move_17.Geometry)

# ---- group: Lote (continued)
area_11 = Area(Geometry=crv_12, UseTasks=False)  # -> Area, Centroid
ma_8 = MassAddition(Input=flatten(area_11.Area))  # -> Result, PartialResults

# ---- group: Comunal (continued)
srf_4 = Surface(offset_2)
move_19 = Move(Geometry=srf_4, Motion=Z)  # -> Geometry, Transform
extr = Extrude(Base=srf_4, Direction=Z_2)
preview_3 = CustomPreview(Geometry=extr, Material=frgb)

# ---- group: PuntoFijoFloors
number_slider_27 = Slider(0.4083, range=0..1)
area_12 = Area(Geometry=move_17.Geometry, UseTasks=False)  # -> Area, Centroid
scale_nu_3 = ScaleNU(Geometry=move_17.Geometry, Plane=area_12.Centroid, ScaleX=number_slider_27, ScaleY=number_slider_27, ScaleZ=1)  # -> Geometry, Transform
addition_12 = Addition(A=lng_3, B=1)
series_3 = Series(Start=0, Step=number_slider_6, Count=addition_12)
Z_6 = UnitZ(Factor=series_3)
move_20 = Move(Geometry=graft(scale_nu_3.Geometry), Motion=Z_6)  # -> simplify(Geometry), Transform
crv_13 = Curve(move_20.Geometry)
flatten_5 = FlattenTree(Tree=crv_13, Path="{0}")
crv_14 = Curve(flatten_5)
frgb_4 = ColourRGBF(Alpha=Slider(1, range=0..1), Red=Slider(1, range=0..1), Green=Slider(1, range=0..1), Blue=Slider(1, range=0..1))
area_13 = Area(Geometry=crv_14, UseTasks=False)  # -> Area, Centroid
ma_9 = MassAddition(Input=area_13.Area)  # -> Result, PartialResults
panel_22 = Panel(ma_9.Result)
item_20 = ListItem(List=area_13.Area, Index=0, Wrap=True)
multiplication_38 = Multiplication(A=item_20, B=number_slider_4)
subtraction_10 = Subtraction(A=ma_9.Result, B=multiplication_38)
previewlw = CustomPreviewLineweights(Geometry=crv_14, Shader=frgb_4, Absolute=False)

# ---- group: I.O
multiplication_39 = Multiplication(A=ma_8.Result, B=number_slider_9)
subtraction_11 = Subtraction(A=ma_8.Result, B=multiplication_39)
ma_10 = MassAddition(Input=[subtraction_11, area_6.Area])  # -> Result, PartialResults
division_24 = Division(A=ma_10.Result, B=area_2.Area)
panel_23 = Panel(division_24)
expression_4 = Expression(
    x=division_24,
    y=Slider(0.31, range=0..10),
    z=Slider(0.24, range=0..1),
    Expression="If( ( x ≤ y ) and ( x ≥ z ), 0, 10000 )")
panel_24 = Panel(expression_4)

# ---- group: OutsideOfArea
crv_15 = Curve(flatten([move_17.Geometry, offset_2]))
disc_3 = Discontinuity(Curve=crv_15, Level=3)  # -> flatten(Points), Parameters
inside_2 = PointWithinCurve(pts=disc_3.Points, crv=pline_9)  # -> simplify(B); inputs pts: list of Point3d, crv: Polyline
# ---------- inside_2: C# ----------
    //int counter = 0;

    int count = pts.Count;

    //Polyline poly = new Polyline();

    //crv.TryGetPolyline(out poly);

    int[] array = new int[count];

    System.Threading.Tasks.Parallel.For(0, count, i => //for( int i = 0; i < count; ++i )
      {

      if( !IsInside(pts[i], crv) )

        array[i] = 1;

      });

    B = array;
# ---------- inside_2: C# additional code ----------
  System.Collections.Concurrent.ConcurrentBag<Point3d> Outside(List<Point3d> pts, Polyline crv)
  {

    var outside = new System.Collections.Concurrent.ConcurrentBag<Point3d>();
    //for( int i = 0; i < pts.BranchCount; ++i )
    System.Threading.Tasks.Parallel.ForEach(pts, pt =>
      {
      if(!IsInside(pt, crv))
      {
        outside.Add(pt);
      }
      });

    return outside;

  }

  bool IsInside (Point3d pt, Polyline crv)
  {
    Point3d pt1, pt2;
    bool oddNodes = false;

    for (int i = 0; i < crv.SegmentCount; i++) //for each contour line
    {

      pt1 = crv.SegmentAt(i).From; //get start and end pt
      pt2 = crv.SegmentAt(i).To;

      if ( (pt1[1] < pt[1] && pt2[1] >= pt[1] || pt2[1] < pt[1] && pt1[1] >= pt[1]) && (pt1[0] <= pt[0] || pt2[0] <= pt[0]) ) //if pt is between pts in y, and either of pts is before pt in x
        oddNodes ^= ( pt2[0] + (pt[1] - pt2[1]) * (pt1[0] - pt2[0]) / (pt1[1] - pt2[1]) < pt[0] ); //^= is xor
      //end.X + (pt-end).Y   * (start-end).X  /(start-end).Y   <   pt.X
    }


    if (!oddNodes)
    {
      double minDist = 1e10;
      for (int i = 0; i < crv.SegmentCount; i++) {
        Point3d cp = crv.SegmentAt(i).ClosestPoint(pt, true);
        //Point3d cp = mvContour[i].closestPoint(pt);
        //minDist = min(minDist, cp.distance(pt));
        minDist = Math.Min(minDist, cp.DistanceTo(pt));
      }
      if (minDist < 1e-10)
        return true;
    }

    if(oddNodes) return true;

    return false;
  }
# ---------- end inside_2 ----------
multiplication_40 = Multiplication(A=inside_2, B=Slider(1000, range=0..1000))
panel_25 = Panel(multiplication_40)

# ---- group: Aislamientos
crv_16 = Curve(flatten(crv_11))
colmm = CollisionManyMany(Colliders=crv_16)  # -> Collision, Indices
multiplication_41 = Multiplication(A=colmm.Collision, B=Slider(2000, range=0..10000))
ma_11 = MassAddition(Input=multiplication_41)  # -> Result, PartialResults
panel_26 = Panel(ma_11.Result)

# ---- group: Collisions
crv_17 = Curve(flatten(crv_15))
colom = CollisionOneMany(Collider=pline_9, Obstacles=crv_17)  # -> Collision, Index
multiplication_42 = Multiplication(A=colom.Collision, B=Slider(3000, range=0..10000))
ma_12 = MassAddition(Input=multiplication_42)  # -> Result, PartialResults
panel_27 = Panel(ma_12.Result)

# ----
hull = ConvexHull(Points=disc_3.Points, Plane=PlaneXY(0, 0, 0))  # -> Hull, HullZ, Indices
rdiff_2 = RegionDifference(CurvesA=hull.Hull, CurvesB=crv)
area_14 = Area(Geometry=hull.Hull, UseTasks=False)  # -> Area, Centroid
area_15 = Area(Geometry=rdiff_2, UseTasks=False)  # -> Area, Centroid
expression_5 = Expression(x=area_14.Area, y=Slider(8300, range=0..10000), Expression="If( x > y, 100000, 0 )")
null = NullItem(Item=area_15.Area)  # -> NullFlags, InvalidFlags, Description
multiplication_43 = Multiplication(A=area_15.Area, B=Slider(1000, range=0..1000))
expression_6 = Expression(x=null.NullFlags, y=Slider(0, range=0..100), z=multiplication_43, Expression="If( x = True, y, z )")
panel_28 = Panel(expression_5)

# ---- group: VolumesPuntoFijo
loft_2 = Loft(Curves=crv_13, Options={Adjust=False, Closed=False, LoftEnds=0, LoftSimp=0, LoftType=0, Rebuild=10, Refit=0.01})
cap = CapHoles(Brep=loft_2)
frgb_5 = ColourRGBF(Alpha=Slider(0.359, range=0..1), Red=Slider(0, range=0..1), Green=Slider(0, range=0..1), Blue=Slider(1, range=0..1))
preview_4 = CustomPreview(Geometry=cap, Material=frgb_5)

# ---- group: AreaPlanta
item_21 = ListItem(List=move_17.Geometry, Index=0, Wrap=True)
area_16 = Area(Geometry=item_21, UseTasks=False)  # -> Area, Centroid
panel_29 = Panel(area_16.Area)

# ----
panel_30 = Panel(expression_6)
lng_12 = ListLength(List=crv_13)
cull_i_5 = CullIndex(List=crv_13, Indices=expr("x-1", lng_12), Wrap=True)

# ---- group: Excel / I.O.
num_10 = Number(division_24)

# ---- group: Floors
move_21 = Move(Geometry=graft(move_17.Geometry), Motion=customgeoplacement.B)  # -> simplify(Geometry), Transform
crv_18 = Curve(move_21.Geometry)
area_17 = Area(Geometry=crv_18, UseTasks=False)  # -> Area, Centroid
flatten_6 = FlattenTree(Tree=crv_18, Path="{0}")
crv_19 = Curve(flatten_6)
frgb_6 = ColourRGBF(Alpha=Slider(1, range=0..1), Red=Slider(0, range=0..1), Green=Slider(0, range=0..1), Blue=Slider(0, range=0..1))
ma_13 = MassAddition(Input=flatten(area_17.Area))  # -> Result, PartialResults
panel_31 = Panel(ma_13.Result)
cull_i_6 = CullIndex(List=area_17.Area, Indices=Slider(0, range=0..100), Wrap=True)
previewlw_2 = CustomPreviewLineweights(Geometry=crv_19, Shader=frgb_6, Absolute=False)

# ---- group: Volumes
loft_3 = Loft(Curves=crv_18, Options={Adjust=False, Closed=False, LoftEnds=0, LoftSimp=0, LoftType=0, Rebuild=10, Refit=0.01})
cap_2 = CapHoles(Brep=loft_3)
frgb_7 = ColourRGBF(Alpha=Slider(0.359, range=0..1), Red=Slider(1, range=0..1), Green=Slider(1, range=0..1), Blue=Slider(1, range=0..1))
preview_5 = CustomPreview(Geometry=cap_2, Material=frgb_7)

# ---- group: Alturas
lng_13 = ListLength(List=move_21.Geometry)
item_22 = ListItem(List=move_21.Geometry, Index=expr("x-1", lng_13), Wrap=True)
item_23 = ListItem(List=move_21.Geometry, Index=0, Wrap=True)
area_18 = Area(Geometry=item_23, UseTasks=False)  # -> Area, Centroid
area_19 = Area(Geometry=item_22, UseTasks=False)  # -> Area, Centroid
vec2pt_2 = Vector2Pt(PointA=area_18.Centroid, PointB=area_19.Centroid, Unitize=False)  # -> Vector, Length
num_11 = Number(flatten(vec2pt_2.Length))
vdis = VectorDisplay(Anchor=area_18.Centroid, Vector=vec2pt_2.Vector)

# ---- group: Floors / ÁreaXTorre
ma_14 = MassAddition(Input=cull_i_6)  # -> simplify(flatten(Result)), PartialResults

# ---- group: Floors / ÁreaTotal
ma_15 = MassAddition(Input=flatten(cull_i_6))  # -> Result, PartialResults

# ---- group: indicadores / áreaTotalConstruida
number_11 = Number(ma_15.Result)

# ---- group: AreaVendible
multiplication_44 = Multiplication(A=ma_15.Result, B=number_slider_9)
subtraction_12 = Subtraction(A=ma_15.Result, B=multiplication_44)
areatotalplantas = Panel(subtraction_12)
ma_16 = MassAddition(Input=flatten([subtraction_12, area_10.Area]))  # -> Result, PartialResults
panel_32 = Panel(ma_16.Result)

# ---- group: I.C
division_25 = Division(A=ma_16.Result, B=area_2.Area)
panel_33 = Panel(division_25)
expression_7 = Expression(
    x=division_25,
    y=Slider(2.4, range=0..10),
    z=Slider(1.7, range=0..10),
    Expression="If( ( x ≤ y ) and ( x ≥ z ), 0, 100000 )")
panel_34 = Panel(expression_7)

# ---- group: indicadores / áreaVendible
number_12 = Number(ma_16.Result)

# ---- group: indicadores
# RELACION M2 VENDIBLES /M2 CONSTRUIDOS = (AREA TOTAL VENDIBLE/AREA CONSTRUIDA )	80%, 	76%, 	84%
division_26 = Division(A=number_12, B=number_11)
multiplication_45 = Multiplication(A=division_26, B=100)
panel_35 = Panel(multiplication_45)

# INDICE DE CONSTRUCCION (AREA CONSTRUIDA VENDIBLE/AREA UTIL)	1.58, 	1.08, 	2.08
division_27 = Division(A=number_12, B=number_10)
panel_36 = Panel(division_27)

# RELACION M2 DE PUNTO FIJO/AREA VENDIBLE=(AREA PUNTOS FIJOS/AREA VENDIBLE)	9.2%, 	8.2%, 	10.2%
division_28 = Division(A=number_6, B=number_12)
multiplication_46 = Multiplication(A=division_28, B=100)
panel_37 = Panel(multiplication_46)

# ---- group: Floors (continued)
panel_38 = Panel(ma_15.Result)

# ----
data_2 = Data(flatten([expression_7, ma_12.Result, expression_4, multiplication_40, expression_5, expression_6, ma_11.Result, expression]))
ma_17 = MassAddition(Input=data_2)  # -> Result, PartialResults
panel_39 = Panel(ma_17.Result)

# ---- group: Excel / I.C.
num_12 = Number(division_25)

# ---- group: Excel
merge_2 = Merge(
    Data1=num,
    Data2=num_2,
    Data3=num_12,
    Data4=num_10,
    Data5=int_3,
    Data6=int_4,
    Data7=round_3.Nearest,
    Data8=round_2.Nearest,
    Data9=int,
    Data10=division_21,
    Data11=division_20,
    Data12=area_6.Area,
    Data13=number_slider_15)
panel_40 = Panel("""Área bruta m2
Área neta urbanizable m2
I.C.
I.O.
Número total aptos.
Parqueaderos privados
Parqueaderos visitantes
Parqueaderos movilidad reducida
Número pisos parqueadero
Relación parqueadero/aptos.
Relación parqueadero/visitantes
Área equipamiento comunal m2
Aislamientos comunal m""")
panel_41 = Panel(item)
anchoslargos_2 = CSharpScript(plantas=item)  # -> ancho, largo; inputs plantas: tree of Rectangle3d; same code as anchoslargos
data_3 = Data(merge_2)
panel_42 = Panel("""Ancho m
Largo m
Pisos
Aislamientos m
Aptos
Altura m""")
button = Button()
c_script_3 = CSharpScript(
    x=data_3,
    y=flatten(anchoslargos_2.ancho),
    z=flatten(anchoslargos_2.largo),
    u=flatten(lng_5),
    v=flatten(num_9),
    w=flatten(round.Nearest),
    xx=flatten(num_11))  # -> out, A; inputs x: list, y: list, z: list, u: list, v: list, w: list, xx: list
# ---------- c_script_3: C# ----------
    var treeOut = new DataTree<object>();

    treeOut.AddRange(x, new GH_Path(0));

    for( int i = 0; i < x.Count; ++i )
    {

      treeOut.Add(null, new GH_Path(1));
      treeOut.Add(null, new GH_Path(2));
      treeOut.Add(null, new GH_Path(3));
      treeOut.Add(null, new GH_Path(4));
      treeOut.Add(null, new GH_Path(5));
      treeOut.Add(null, new GH_Path(6));

    }

    treeOut.AddRange(y, new GH_Path(1));
    treeOut.AddRange(z, new GH_Path(2));
    treeOut.AddRange(u, new GH_Path(3));
    treeOut.AddRange(v, new GH_Path(4));
    treeOut.AddRange(w, new GH_Path(5));
    treeOut.AddRange(xx, new GH_Path(6));

    A = treeOut;
# ---------- end c_script_3 ----------
lng_14 = ListLength(List=flatten(num_9))
c_script_4 = CSharpScript(x=panel_40, y=lng_14)  # -> out, A; inputs x: list, y: Int32
# ---------- c_script_4: C# ----------
    for( int i = 1; i <= y; ++i )
    {

      string str = "Torre " + i.ToString();

      x.Add(str);

    }

    A = x;
# ---------- end c_script_4 ----------
writexl = WriteToExcel(
    Run=Toggle(False),
    ExcelWorksheet="1",
    ColumnNames=panel_42,
    RowNames=c_script_4.A,
    WriteOptions="None",
    ColumnnsOrRows=False,
    DataToWriteIntoColumns=c_script_3.A)
panel_43 = Panel(c_script_4.A)
panel_44 = Panel(c_script_3.A)
